# Grasshopper definition ACD - Julius Drejer Mosgaard - Assignment 3.gh (Grasshopper 1.0.8)

panel = Panel("G:\My Drive\SDU\ACD\Github folder\A3-jmosg22\images\surfaceimg1.png")
panel_2 = Panel("G:\My Drive\SDU\ACD\Github folder\A3-jmosg22\images\surfaceimg2.png")
panel_3 = Panel("G:\My Drive\SDU\ACD\Github folder\A3-jmosg22\images\surfaceimg3.png")
optional_min_size_of_each_tesselate_patc = Slider(0, range=0..1000)  # "Optional min size of each tesselate patch"
curvature_control_color_spike_prevention = Slider(2, range=0..10)
max_angle_difference_fore_tesselation = Slider(2, range=0..100)
max_number_of_different_patch_sizes = Slider(6, range=0..10)
max_angle_of_outward_tree_growth = Slider(15, range=0..90)
vector_amplitude_of_each_branch = Slider(40, range=0..100)
surface_height_canopy_height = Slider(180, range=0..1000)
panel_4 = Panel("""Amplitude: 30
Frequency: 3
H x W: 100""")
panel_5 = Panel("""Amplitude: 50
Frequency: 4
H x W: 100""")
panel_6 = Panel("""Amplitude: 40
Frequency: 5
H x W: 100""")
tree_recursions = Slider(8, range=0..10)
scale_of_each_branch = Slider(1, range=0..1)
radius_at_pipe_base = Slider(5, range=0..10)
seed_of_tree_fractal = Slider(2, range=0..10)
surface_thicknesss = Slider(2, range=0..10)
uv_count = Slider(50, range=0..100)

# ---- group: Img to Pts to Srf
imgtopts = Python3Script(Image=panel_3, ScaleZ=curvature_control_color_spike_prevention, U=uv_count, V=uv_count)  # -> Pts, x_steps, y_steps, U, srf
# ---------- imgtopts: Python ----------
import Rhino
import System
from System.Drawing import Bitmap, Imaging
from System.Runtime.InteropServices import Marshal
import Rhino.Geometry as rg
import scriptcontext as sc

# Read the image
if isinstance(Image, str):
    bmp = Bitmap(Image)
elif isinstance(Image, Bitmap):
    bmp = Image
else:
    raise ValueError("Input 'Image' must be a file path or a Bitmap.")

width  = bmp.Width
height = bmp.Height

W = width
H = height

# Lock bitmap and copy rawdata
rect = System.Drawing.Rectangle(0, 0, width, height)
bmpdata = bmp.LockBits(rect, Imaging.ImageLockMode.ReadOnly, Imaging.PixelFormat.Format24bppRgb)

stride = bmpdata.Stride
byte_count = stride * height

buf = System.Array.CreateInstance(System.Byte, byte_count)
Marshal.Copy(bmpdata.Scan0, buf, 0, byte_count)

bmp.UnlockBits(bmpdata)

# Downsampling grid size by U x V input
U = int(U)
V = int(V)

# Evenly spaced sampling positions across the image
x_steps = [i * (width - 1) / (int(U) - 1) for i in range(int(U))]
y_steps = [i * (height - 1) / (int(V) - 1) for i in range(int(V))]

Pts = []

# Sample each image RGB value and convert to xyz coordinate. (x,y is location, z is height)
for y in y_steps:
    yi = int(y)
    row_offset = yi * stride

    for x in x_steps:
        xi = int(x)
        base = row_offset + xi * 3

        B = buf[base]
        G = buf[base + 1]
        R = buf[base + 2]

        # Avoiding high z-value as colour codes are more prevalent, and adding a scale factor.
        Z = (0.2126 * R + 0.7152 * G + 0.0722 * B) * ScaleZ

        Pts.append(Rhino.Geometry.Point3d(float(x), float(y), float(Z)))

        

real_pts = []

for p in Pts:
    if isinstance(p, rg.Point3d):
        # Already correct
        real_pts.append(p)

    elif isinstance(p, rg.Point):
        # Grasshopper Point geometry
        real_pts.append(p.Location)

    elif isinstance(p, Rhino.DocObjects.PointObject):
        # A Rhino doc point object
        real_pts.append(p.Geometry.Location)

    elif isinstance(p, System.Guid):
        # GUID → retrieve Rhino object → convert to Point3d
        rh_obj = sc.doc.Objects.Find(p)
        if rh_obj and hasattr(rh_obj.Geometry, "Location"):
            real_pts.append(rh_obj.Geometry.Location)
        else:
            raise TypeError("Guid does not refer to a point.")

    else:
        raise TypeError("Unsupported point type: {}".format(type(p)))

# pts: list of Rhino.Geometry.Point3d
# U: U count
# interpolate: boolean

# Convert the flat list into a 2D point grid.
V = len(real_pts) // U

# Reshape flat list into UV grid
point_grid = []
for v in range(V):
    row = []
    for u in range(U):
        row.append(real_pts[v * U + u])
    point_grid.append(row)

# Create the surface
if interpolate:
    # Interpolated surface (more precise)
    srf = rg.NurbsSurface.CreateThroughPoints(point_grid, U, V, 3, 3, False, False)
else:
    # Least squares surface (same method GH uses when 'Interpolate' = False)
    srf = rg.NurbsSurface.CreateFromPoints(real_pts, U, V, 3, 3)

# Output
a = srf
# ---------- end imgtopts ----------

# ---- group: Point for supports
py3 = Python3Script(srf=imgtopts.srf, Ucount=imgtopts.U, Vcount=imgtopts.U, region_tol=Slider(0.3, range=0..1))  # -> out, centers
# ---------- py3: Python ----------
import rhinoscriptsyntax as rs
import scriptcontext as sc
import Rhino.Geometry as rg
import math


# Convert GUID to geometry


srf_obj = rs.coercesurface(srf)
if srf_obj is None:
    brep = rs.coercebrep(srf)
    if brep:
        srf_obj = brep.Faces[0].ToNurbsSurface()
    else:
        raise Exception("Input is not a surface or brep.")


# Sample surface points + normals


pts = []
normals = []
zs = []

dom_u = srf_obj.Domain(0)
dom_v = srf_obj.Domain(1)

for i in range(Ucount):
    for j in range(Vcount):
        # correct UV parameters
        u = dom_u.ParameterAt(float(i)/(Ucount-1))
        v = dom_v.ParameterAt(float(j)/(Vcount-1))

        pt = srf_obj.PointAt(u, v)
        n = srf_obj.NormalAt(u, v)
        n.Unitize()

        pts.append(pt)
        normals.append(n)
        zs.append(pt.Z)


# Detect lowest flat areas


min_z = min(zs)

# tolerances (set reasonable defaults)
z_tolerance = 0.5          # points within 0.5 units of lowest Z  
angle_tol = math.radians(3)  # normals within 3 degrees considered flat

# average normal among lowest 5% of points
count_5 = max(1, int(len(pts) * 0.05))
lowest_indices = sorted(range(len(zs)), key=lambda i: zs[i])[:count_5]

avg_n = rg.Vector3d(
    sum(normals[i].X for i in lowest_indices) / count_5,
    sum(normals[i].Y for i in lowest_indices) / count_5,
    sum(normals[i].Z for i in lowest_indices) / count_5
)
avg_n.Unitize()

flat_low_points = []

for pt, n, z in zip(pts, normals, zs):
    # correct "parallel" test
    if n.IsParallelTo(avg_n, angle_tol) != 0:
        if abs(z - min_z) <= z_tolerance:
            flat_low_points.append(pt)


# Cluster flat regions spatially


clusters = []
used = set()

def dist(a,b): return a.DistanceTo(b)

# 5% of diagonal -> merge points from same flat region
bbox = srf_obj.GetBoundingBox(True)
cluster_tol = bbox.Diagonal.Length * region_tol

for i, p in enumerate(flat_low_points):
    if i in used: continue
    group = [p]
    used.add(i)

    for j, q in enumerate(flat_low_points):
        if j in used: continue
        if dist(p, q) < cluster_tol:
            group.append(q)
            used.add(j)
    clusters.append(group)


# Compute centroid of each region


centers = []

for group in clusters:
    x = sum(p.X for p in group) / len(group)
    y = sum(p.Y for p in group) / len(group)
    z = sum(p.Z for p in group) / len(group)
    centers.append(rg.Point3d(x, y, z))
# ---------- end py3 ----------

# ---- group: Generate supports
py3_2 = Python3Script(
    gen=tree_recursions,
    angle=max_angle_of_outward_tree_growth,
    L=scale_of_each_branch,
    s=seed_of_tree_fractal,
    height=vector_amplitude_of_each_branch,
    pts=py3.centers)  # -> out, Lines; inputs pts: list
# ---------- py3_2: Python ----------
import rhinoscriptsyntax as rs
import random
import Rhino
import math
from collections import defaultdict

# Inputs:
# pts = list of base points where trees must grow
# height, gen, angle, L, s

Lines = []

def Grow(pt, v, length, g):
    if g < gen:
        plane = rs.PlaneFromNormal(pt, v)
        random_pt = rs.EvaluatePlane(plane, [random.uniform(-1, 1), random.uniform(-1, 1)])
        rot_axis = rs.VectorCreate(random_pt, pt)
    
        V1 = rs.VectorRotate(v, random.uniform(-angle, 0), rot_axis)
        pt1 = rs.PointAdd(pt, rs.VectorScale(V1, length))

        m1 = [pt[0], pt[1], pt[2] + (pt1[2] - pt[2]) * 0.5]
        m2 = [pt1[0], pt1[1], pt[2] + (pt1[2] - pt[2]) * 0.5]

        V2 = rs.VectorRotate(v, random.uniform(0, angle), rot_axis)
        pt2 = rs.PointAdd(pt, rs.VectorScale(V2, length))
        
        m3 = [pt[0], pt[1], pt[2] + (pt2[2] - pt[2]) * 0.5]
        m4 = [pt2[0], pt2[1], pt[2] + (pt2[2] - pt[2]) * 0.5]

        L1 = rs.AddCurve([pt, m1, m2, pt1])
        L2 = rs.AddCurve([pt, m3, m4, pt2])

        Lines.append(L1)
        Lines.append(L2)
        
        Grow(pt1, V1, length * random.uniform(0.75, 0.95), g + 1)
        Grow(pt2, V2, length * random.uniform(0.75, 0.95), g + 1)

random.seed(s)

# Vector amplitude controlled by height
V = [0, 0, height]

# Points for supports
for pt in pts:
    B = rs.PointAdd(pt, rs.VectorScale(V, L))  # first branch
    Lines.append(rs.AddLine(pt, B))
    Grow(B, V, L, 0)

# Output
trees = Lines
# ---------- end py3_2 ----------

# ---- group: Cut supports at surface
py3_3 = Python3Script(srf=imgtopts.srf, lines=py3_2.Lines, srf_z=surface_height_canopy_height)  # -> out, lines_cut, srf_moved; inputs lines: list
# ---------- py3_3: Python ----------
import rhinoscriptsyntax as rs
import Rhino
import Rhino.Geometry as rg
import scriptcontext as sc

# Convert input surface to real geometry
geo = rs.coercegeometry(srf)
if isinstance(geo, rg.Brep):
    srf_obj = geo.Faces[0].ToNurbsSurface()
elif isinstance(geo, rg.Surface):
    srf_obj = geo.ToNurbsSurface()
else:
    raise Exception("Input srf must be a surface or brep.")

# Convert all lines to actual geometry
lines_list = []
for l in lines:
    crv = rs.coercecurve(l)
    if crv:
        lines_list.append(crv)



# Move the surface upward by srf_z


xf = rg.Transform.Translation(0, 0, srf_z)
srf_moved = srf_obj.Duplicate()
srf_moved.Transform(xf)

# Intersect + trim each line

lines_cut = []

for crv in lines_list:

    # Get intersection with surface
    results = rg.Intersect.Intersection.CurveSurface(
        crv, srf_moved, 0.001, 0.001
    )

    if results and results.Count > 0:
        # take first intersection
        inter = results[0]
        t = inter.ParameterA
        pt = crv.PointAt(t)

        # Only keep the segment from start → intersection
        trimmed_curve = rg.Line(crv.PointAtStart, pt).ToNurbsCurve()
        lines_cut.append(trimmed_curve)

    else:
        # Check the end point
        start = crv.PointAtStart
        end = crv.PointAtEnd

        # Evaluate surface at projection of line start
        # Here we assume Z height is what matters
        if start.Z < srf_moved.GetBoundingBox(True).Max.Z:
            lines_cut.append(crv)
        # if line is fully above → ignore it completely
# ---------- end py3_3 ----------

# ----
crv = Curve(py3_3.lines_cut)

# ---- group: Tesselation
py3_4 = Python3Script(
    S=py3_3.srf_moved,
    ResU=imgtopts.U,
    ResV=imgtopts.U,
    MaxAngle=max_angle_difference_fore_tesselation,
    MinSize=optional_min_size_of_each_tesselate_patc,
    MaxDepth=max_number_of_different_patch_sizes)  # -> patches, Edges; inputs S: Brep, ResU: Int32, MaxAngle: Int32, MinSize: Int32, MaxDepth: Int32
# ---------- py3_4: Python ----------
import Rhino.Geometry as rg
import math

# -------- INPUT CLEANING --------
if isinstance(S, rg.Brep):
    surf = S.Faces[0].ToNurbsSurface()
elif isinstance(S, rg.Surface):
    surf = S.ToNurbsSurface()
else:
    raise ValueError("Input must be Brep or Surface")

angle_tol = math.radians(MaxAngle)

u_dom = surf.Domain(0)
v_dom = surf.Domain(1)


# -------- HELPERS --------
def normal_angle(n1, n2):
    dot = max(-1.0, min(1.0, n1*n2))
    return math.acos(dot)

def patch_min_edge_length(pts):
    return min((pts[i].DistanceTo(pts[(i+1)%4]) for i in range(4)))


# -------- RECURSIVE SUBDIVISION --------
patches = []
boundaries = []


def subdivide(u0, u1, v0, v1, depth):

    # SAMPLE POINTS
    pts_uv = [
        (u0, v0),
        (u1, v0),
        (u1, v1),
        (u0, v1),
        ((u0+u1)*0.5, (v0+v1)*0.5)
    ]

    pts = [surf.PointAt(u, v) for (u, v) in pts_uv]
    normals = [surf.NormalAt(u, v) for (u, v) in pts_uv]

    # STOP RULE 1: patch is too small
    if patch_min_edge_length(pts[:4]) < MinSize:
        small = True
    else:
        small = False

    # COMPUTE NORMAL VARIATION
    max_diff = 0.0
    for i in range(5):
        for j in range(i+1, 5):
            ang = normal_angle(normals[i], normals[j])
            if ang > max_diff:
                max_diff = ang

    # STOP RULE 2: angle OK or patch too small or depth limit
    if max_diff <= angle_tol or small or depth >= MaxDepth:
        m = rg.Mesh()

        idx = []
        for (u, v) in [(u0, v0), (u1, v0), (u1, v1), (u0, v1)]:
            idx.append(int(m.Vertices.Add(surf.PointAt(u, v))))

        m.Faces.AddFace(idx[0], idx[1], idx[2], idx[3])
        m.Normals.ComputeNormals()
        patches.append(m)

        boundaries.append(
            rg.Polyline([pts[0], pts[1], pts[2], pts[3], pts[0]])
        )
        return

    # OTHERWISE: SUBDIVIDE INTO 4
    um = (u0 + u1)*0.5
    vm = (v0 + v1)*0.5

    subdivide(u0, um, v0, vm, depth+1)
    subdivide(um, u1, v0, vm, depth+1)
    subdivide(u0, um, vm, v1, depth+1)
    subdivide(um, u1, vm, v1, depth+1)


# START 
subdivide(u_dom.T0, u_dom.T1, v_dom.T0, v_dom.T1, 0)


# OUTPUT 
Patches = patches
Edges = boundaries
# ---------- end py3_4 ----------

# ---- group: cull supports above srf
py3_5 = Python3Script(srf=py3_3.srf_moved, crvs=py3_3.lines_cut, side=Toggle(True))  # -> out, curves_out; inputs srf: Brep, crvs: list
# ---------- py3_5: Python ----------
import rhinoscriptsyntax as rs
import Rhino.Geometry as rg
import System


# Convert surface input
geo = rs.coercegeometry(srf)
if isinstance(geo, rg.Brep):
    srf_obj = geo.Faces[0]
elif isinstance(geo, rg.Surface):
    srf_obj = geo
else:
    raise Exception("Input srf must be a surface or brep.")


# Signed distance function
def signed_distance(pt, surface):
    rc, u, v = surface.ClosestPoint(pt)
    if not rc:
        return None

    pt_on_srf = surface.PointAt(u, v)
    n = surface.NormalAt(u, v)
    n.Unitize()

    vpt = pt - pt_on_srf
    return rg.Vector3d.Multiply(n, vpt)


# 🔧 Helper: Accept both GUIDs and RhinoCommon curves
def get_curve(c):
    # GUID → convert
    if isinstance(c, System.Guid):
        return rs.coercecurve(c)

    # Already a RhinoCommon curve
    if isinstance(c, rg.Curve):
        return c

    return None



# Process curves
crvs_out = []

for c in crvs:

    # If nested lists from GH
    if isinstance(c, (list, tuple)):
        for sub in c:
            crv = get_curve(sub)
            if crv is None:
                continue

            t_mid = crv.Domain.Mid
            pt_mid = crv.PointAt(t_mid)
            d = signed_distance(pt_mid, srf_obj)

            if d is None:
                continue
            if (side and d > 0) or (not side and d < 0):
                crvs_out.append(crv)
        continue

    # Normal single curve
    crv = get_curve(c)
    if crv is None:
        continue

    t_mid = crv.Domain.Mid
    pt_mid = crv.PointAt(t_mid)
    d = signed_distance(pt_mid, srf_obj)

    if d is None:
        continue
    if (side and d > 0) or (not side and d < 0):
        crvs_out.append(crv)


curves_out = crvs_out
# ---------- end py3_5 ----------

# ----
crv_2 = Curve(py3_4.Edges)

# ---- group: Variable pipe
py3_6 = Python3Script(crvs=py3_5.curves_out, factor=radius_at_pipe_base)  # -> out, pipes; inputs crvs: list
# ---------- py3_6: Python ----------
# Inputs:
#   crvs   : list (curve GUIDs or Rhino.Geometry.Curve)
#   factor : float                                     
#
# Outputs:
#   pipes         : list of Breps (piped curves)

import rhinoscriptsyntax as rs
import Rhino.Geometry as rg
import scriptcontext as sc
import math
from System.Collections.Generic import List

#  prepare outputs 
pipes = []
weave_radii = []
radii_end = []
radii_start = []

# safe coercion of incoming curves (handles GUIDs)
geo_crvs = []
for c in crvs:
    try:
        cc = rs.coercecurve(c)   # returns None if not a curve
    except Exception:
        cc = None
    geo_crvs.append(cc)

# collect all start/end Z values 
z_values = []
for c in geo_crvs:
    if c is None:
        continue
    sp = c.PointAtStart
    ep = c.PointAtEnd
    z_values.append(sp.Z)
    z_values.append(ep.Z)

# If no valid curves, leave outputs empty
if not z_values:
    # pipes, radii_start, radii_end, weave_radii remain empty lists
    pass
else:
    # Domain end value (max Z) -- emulates Deconstruct Domain -> End
    z_max = max(z_values)

    # guard against z_max == 0 (avoid division by zero)
    if abs(z_max) < 1e-12:
        z_max = 1.0

    # compute normalization streams: (z_max - z) / z_max
    norm_start = []
    norm_end   = []

    for c in geo_crvs:
        if c is None:
            norm_start.append(0.0)
            norm_end.append(0.0)
            continue
        sp = c.PointAtStart
        ep = c.PointAtEnd
        n0 = (z_max - sp.Z) / z_max
        n1 = (z_max - ep.Z) / z_max
        norm_start.append(n0)
        norm_end.append(n1)

   # Pythoncopy of the Weave (weave start & end into a single stream)

    woven = [[s, e] for s, e in zip(norm_start, norm_end)]

    # multiply by factor (the multiplication component after the weave)
    # this yields the final radii used by Pipe Variable
    for pair in woven:
        r0 = max(pair[0] * factor, 0.0)
        r1 = max(pair[1] * factor, 0.0)
        weave_radii.append([r0, r1])
        radii_start.append(r0)
        radii_end.append(r1)

    # Now create pipes: curves are reparameterized and grafted (like in the grasshopper component "Pipe Variable")
    try:
        tol = sc.doc.ModelAbsoluteTolerance
    except Exception:
        tol = 0.01

    ang_tol = math.radians(1.0)  # 1 degree in radians

    for c, (r0, r1) in zip(geo_crvs, weave_radii):
        if c is None:
            pipes.append(None)
            continue

        # duplicate curve before changing parameterization
        try:
            crv = c.DuplicateCurve()
        except Exception:
            crv = c

        # reparameterize to 0..1 (like the Reparameterize in grasshopper)
        try:
            crv.Reparameterize(0.0, 1.0)
        except Exception:
            # if Reparameterize isn't available/allowed, ignore
            pass

        # parameters list per curve: multi-line list of 0 and 1 (emulates Pipe Variable "parameters" multi-list)
        params_dotnet = List[float]([0.0, 1.0])
        radii_dotnet  = List[float]([float(r0), float(r1)])

        # If either radius is zero, CreatePipe may still return a pipe depending on curve; keep values >= 0
        try:
            # correct overload with angleToleranceRadians included
            breps = rg.Brep.CreatePipe(
                crv,
                params_dotnet,
                radii_dotnet,
                False,                    # cap (False = open)
                rg.PipeCapMode.Flat,     # cap mode (Flat/Round)
                True,                     # fit rail
                tol,                      # tolerance
                ang_tol                   # angle tolerance in radians
            )
        except Exception:
            breps = None

        if breps and len(breps) > 0:
            pipes.append(breps[0])
        else:
            pipes.append(None)
# ---------- end py3_6 ----------

# ---- group: Mesh to brep and offset
py3_7 = Python3Script(M=py3_4.patches, dist=surface_thicknesss, solid=Toggle(True), ext=Toggle(False), tol=Toggle(False))  # -> FacesPts, brep_off, cbrep
# ---------- py3_7: Python ----------
import Rhino
import Rhino.Geometry as rg
import scriptcontext as sc
import rhinoscriptsyntax as rs
import System
import math

# INPUT: M  -> a mesh, list of meshes, GUIDs, or ObjRefs
# OUTPUT: FacesPts (list of lists of Point3d), Surfaces (list of Breps)

def resolve_mesh(obj):
    """Try to return a Rhino.Geometry.Mesh from various possible inputs:
       - actual Mesh
       - Rhino.DocObjects.ObjRef
       - System.Guid (object id)
       - Rhino object from RhinoCommon
    Returns None if it couldn't resolve a mesh.
    """
    if obj is None:
        return None

    # already a Mesh
    if isinstance(obj, rg.Mesh):
        return obj

    # Rhino ObjRef
    try:
        if isinstance(obj, Rhino.DocObjects.ObjRef):
            geom = obj.Geometry()
            if isinstance(geom, rg.Mesh):
                return geom
            # Some geometry may be a Brep with a mesh representation:
            if isinstance(geom, rg.Brep):
                # try get a mesh from Brep (meshes of brep faces)
                m = rg.Mesh()
                if rg.Mesh.CreateFromBrep(geom, rg.MeshingParameters.Default, m):
                    return m
    except Exception:
        pass

    # GUID (System.Guid) or string representation of id
    try:
        if isinstance(obj, System.Guid) or isinstance(obj, str):
            # find by id in document
            found = sc.doc.Objects.Find(obj)
            if found:
                geom = found.Geometry
                if isinstance(geom, rg.Mesh):
                    return geom
                if isinstance(geom, rg.Brep):
                    m = rg.Mesh()
                    if rg.Mesh.CreateFromBrep(geom, rg.MeshingParameters.Default, m):
                        return m
    except Exception:
        pass

    # sometimes Grasshopper passes wrappers with .Geometry or .Object
    try:
        if hasattr(obj, "Geometry"):
            geom = obj.Geometry
            if isinstance(geom, rg.Mesh):
                return geom
            if isinstance(geom, rg.Brep):
                m = rg.Mesh()
                if rg.Mesh.CreateFromBrep(geom, rg.MeshingParameters.Default, m):
                    return m
    except Exception:
        pass

    # last attempt: if it has Faces and Vertices attributes, treat as mesh-like
    try:
        if hasattr(obj, "Faces") and hasattr(obj, "Vertices"):
            # assume it's mesh-like
            return obj
    except Exception:
        pass

    return None


# Ensure M is a list
mesh_inputs = M if isinstance(M, (list, tuple)) else [M]

FacesPts = []
Surfaces = []

for mi in mesh_inputs:
    mesh = resolve_mesh(mi)
    if mesh is None:
        # skip non-resolvable inputs
        continue

    # ensure mesh has correct topology/normals
    try:
        mesh.Normals.ComputeNormals()
    except Exception:
        pass

    # iterate faces
    for f in mesh.Faces:
        # get vertex indices for the face (quad or triangle)
        if f.IsQuad:
            ids = [f.A, f.B, f.C, f.D]
        else:
            # triangle -> duplicate last vertex so we have 4 points
            ids = [f.A, f.B, f.C, f.C]

        # collect 3D points (Point3d)
        try:
            pts = [rg.Point3d(mesh.Vertices[i]) for i in ids]
        except Exception:
            # if indexing fails, skip this face
            continue

        FacesPts.append(pts)

        # attempt to create planar Brep from corner points
        try:
            brep = rg.Brep.CreateFromCornerPoints(pts[0], pts[1], pts[2], pts[3], sc.doc.ModelAbsoluteTolerance)
        except Exception:
            brep = None

        # If CreateFromCornerPoints failed (non-planar), try making a ruled surface:
        if brep is None:
            try:
                # create a surface via lofting the two edge curves
                crv1 = rg.LineCurve(pts[0], pts[1])
                crv2 = rg.LineCurve(pts[3], pts[2])
                loft = rg.Brep.CreateFromLoft([crv1, crv2], rg.Point3d.Unset, rg.Point3d.Unset, rg.LoftType.Normal, False)
                if loft:
                    brep = loft[0]
            except Exception:
                brep = None

        if brep is not None:
            Surfaces.append(brep)

cbrep = rs.coercebrep(brep)
tol = sc.doc.ModelAbsoluteTolerance

b = Rhino.Geometry.Brep.CreateOffsetBrep(cbrep, dist, solid, ext, tol)

brep_off = b[0]
# ---------- end py3_7 ----------

# ---- group: final canopy with sups
brep = Brep([py3_7.brep_off, py3_6.pipes])
